vi "Main.gvi"   [LabVIEW NXG 2.1.0]
panel controls:
  "clear-errors": bool
panel indicators:
  "Output": error
  "tags": "Tag.gtype"[]
  "Output_2": error
  "element": "Tag.gtype"[]
  "value": f64
types:
  "DataType.gtype" = enum{"Double", "Integer", "String"}
  "Client Handle.gtype" = u32
  "Configuration.gtype" = cluster{"Server URL": string, "Session": "Client Handle.gtype"}
  "Tag.gtype" = cluster{"Path": string, "Datatype": "DataType.gtype", "Configuration": "Configuration.gtype"}
uses:
  NI::Skyline::Configuration::Open Configuration API Key (Desktop).gvi
  NI::Skyline::Configuration::Open Configuration (Desktop).gvi
  local-cloud-connector::check-for-errors.gvi
  NI::Skyline::TagHTTP::Query Tags.gvi
  NI::Skyline::TagHTTP::Open Tag.gvi
  NI::Skyline::TagHTTP::Read Tag (DBL).gvi
  NI::Skyline::TagHTTP::Write Tag (DBL).gvi
diagram:
  disable {
    frame Enabled {
      call "Open Configuration API Key (Desktop).gvi"(server url="https://api.systemlinkcloud.com", api key="aR1FfRtwtREAKnWAfp4sqwCiCxWCve82km5jf-VZgE") -> (configuration=w2, error out=w1)
    }
    frame Disabled {
      call "Open Configuration (Desktop).gvi"()
    }
  }
  w3 = "init"  # query-statemachine-states
  Obtain Queue(element data type="Tag.gtype"[] [], error in=w1) -> (error out=w4, queue out=w5)
  s1 = w3  # shift register
  s2 = w4  # shift register
  s3 = uninitialised  # shift register
  while {
    Wait(time to wait=1000)
    case (s1) {
      frame "init", Default {
        call "check-for-errors.gvi"(Error In=s2, query-statemachine-states="query") -> (Error Out=w7, query-statemachine-states_2=w6)
        w8 = s3
      }
      frame "query" {
        call "Query Tags.gvi"(paths=["2018springhackathon.*"], error in=s2, configuration=w2) -> (tags=w8, error out=w9)
        $tags <- w8
        w10 = "wait"  # query-statemachine-states
        w11 = "open tags"  # query-statemachine-states
        Is Equal[ComparisonMode=CompareAggregates](x=s3, y=w8) -> w12
        Select(s=w12, t=w10, f=w11) -> w13
        call "check-for-errors.gvi"(Error In=w9, query-statemachine-states=w13) -> (Error Out=w7, query-statemachine-states_2=w6)
      }
      frame "open tags" {
        for {
          w14 = each element of s3
          Property Node(instance in=w14) -> ("Configuration"=w16, "Path"=w17, "Datatype"=w18)
          case (w18) {
            frame "Double", Default {
              call "Open Tag.gvi"(path=w17, data type=w18, error in=s2, configuration=w16) -> (tag out=w19, error out=w20)
            }
            frame "Integer" {
              call "Open Tag.gvi"(path=w17, data type=w18, error in=s2, configuration=w16) -> (tag out=w19, error out=w20)
            }
            frame "String" {
              call "Open Tag.gvi"(path=w17, data type=w18, error in=s2, configuration=w16) -> (tag out=w19, error out=w20)
            }
          }
          append w19 to w15
        }
        Enqueue Element(element=w15, error in=w20, queue=w5) -> (error out=w21)
        call "check-for-errors.gvi"(Error In=w21, query-statemachine-states="wait") -> (Error Out=w7, query-statemachine-states_2=w6)
        w8 = s3
      }
      frame "handle errors" {
        $Output <- s2
        Select(s=$"clear-errors", t=no error, f=s2) -> w22
        call "check-for-errors.gvi"(Error In=w22, query-statemachine-states="wait") -> (Error Out=w7, query-statemachine-states_2=w6)
        w8 = s3
      }
      frame "wait" {
        call "check-for-errors.gvi"(Error In=s2, query-statemachine-states="query") -> (Error Out=w7, query-statemachine-states_2=w6)
        w8 = s3
      }
    }
    next s1 = w6
    next s2 = w7
    next s3 = w8
    stop if FALSE
  }
  s4 = uninitialised  # shift register
  s5 = w3  # shift register
  s6 = uninitialised  # shift register
  s7 = uninitialised  # shift register
  s8 = uninitialised  # shift register
  while {
    # cloud tags
    # cloud tags
    case (s5) {
      frame "init", Default {
        disable {
          frame Enabled {
            call "Open Configuration API Key (Desktop).gvi"(server url="https://api.systemlinkcloud.com", api key="aR1FfRtwtREAKnWAfp4sqwCiCxWCve82km5jf-VZgE", error in=s4) -> (configuration=w26, error out=w28)
          }
          frame Disabled {
            call "Open Configuration (Desktop).gvi"(error in=s4) -> (error out=w28)
          }
        }
        call "check-for-errors.gvi"(Error In=w28, query-statemachine-states="update-tag-list") -> (Error Out=w23, query-statemachine-states_2=w24)
        w25 = s6
        w27 = s8
      }
      frame "handle errors" {
        $Output_2 <- s4
        call "check-for-errors.gvi"(Error In=s4, query-statemachine-states="update-tag-list") -> (Error Out=w23, query-statemachine-states_2=w24)
        w25 = s6
        w26 = s7
        w27 = s8
      }
      frame "read-write" {
        for {
          w29 = each element of s6
          w30 = each element of s8
          call "Read Tag (DBL).gvi"(tag in=w29, error in=s4) -> (value=w31, error out=w32)
          call "Write Tag (DBL).gvi"(tag in=w30, value=w31, error in=w32) -> (error out=w33)
          $value <- w31
        }
        call "check-for-errors.gvi"(Error In=w33, query-statemachine-states="update-tag-list") -> (Error Out=w23, query-statemachine-states_2=w24)
        w25 = s6
        w26 = s7
        w27 = s8
      }
      frame "update-tag-list" {
        Dequeue Element(error in=s4, queue=w5, timeout in ms=100) -> (element=w34, error out=w35, timed out?=w36)
        Select(s=w36, t=s6, f=w34) -> w25
        $element <- w25
        case (w36) {
          frame False, Default {
            for {
              w38 = each element of w25
              Property Node(instance in=w38) -> ("Path"=w39, "Datatype"=w40)
              Concatenate Strings("cloud.", w39) -> w41
              call "Open Tag.gvi"(path=w41, data type=w40, error in=w35, configuration=s7) -> (tag out=w42, error out=w37)
              append w42 to w27
            }
          }
          frame True {
            w37 = w35
            w27 = s8
          }
        }
        call "check-for-errors.gvi"(Error In=w37, query-statemachine-states="read-write") -> (Error Out=w23, query-statemachine-states_2=w24)
        w26 = s7
      }
    }
    next s4 = w23
    next s5 = w24
    next s6 = w25
    next s7 = w26
    next s8 = w27
    stop if FALSE
  }
